# Grasshopper definition 01.gh (Grasshopper 0.9.76)

number_slider = Slider(0, range=0..100)
number_slider_2 = Slider(180, range=0..180)
dom = ConstructDomain(DomainStart=number_slider, DomainEnd=number_slider_2)
dom_2 = ConstructDomain(DomainStart=number_slider_2, DomainEnd=number_slider)
pt = Point(Point(105.6903588, -9.236412095, 0))
rad = Radians(Degrees=dom)
rad_2 = Radians(Degrees=dom_2)
number_slider_3 = Slider(30, range=0..100)
arc = Arc(Plane=pt, Radius=Slider(100, range=0..100), Angle=rad)  # -> Arc, Length
arc_2 = Arc(Plane=pt, Radius=Slider(50, range=0..100), Angle=rad_2)  # -> Arc, Length
divide = DivideCurve(Curve=arc.Arc, Count=number_slider_3, Kinks=False)  # -> Points, Tangents, Parameters
divide_2 = DivideCurve(Curve=arc_2.Arc, Count=Slider(30, range=0..100), Kinks=False)  # -> reverse(Points), Tangents, Parameters
points = PointList(Points=divide_2.Points, Size=Slider(6, range=0..10))
points_2 = PointList(Points=divide.Points, Size=Slider(6, range=0..10))
ln = Line(StartPoint=divide.Points, EndPoint=divide_2.Points)
dom_3 = ConstructDomain(DomainStart=Slider(1.1, range=0..10), DomainEnd=Slider(2.2, range=0..10))
range = Range(Domain=dom_3, Steps=number_slider_3)
len = Length(Curve=ln)
multiplication = Multiplication(A=len, B=range)
Z = UnitZ(Factor=1)
merge = Merge(Data1=arc.Arc, Data2=arc_2.Arc)
cat = Catenary(PointA=divide.Points, PointB=divide_2.Points, Length=multiplication, Gravity=Z)
pipe = Pipe(Curve=[merge, cat], Radius=Slider(1, range=0..1), Caps=0)
