# Grasshopper definition 02.gh (Grasshopper 0.9.76)

xy = XYPlane(Origin=Point(0, 0, 0))
Y = UnitY(Factor=Slider(33, range=0..100))

hexgrid = Hexagonal(Plane=PlaneXY(0, 0, 0), Size=Slider(0.5, range=0..1), ExtentX=Slider(28, range=0..100), ExtentY=Slider(13, range=0..100))  # -> flatten(Cells), flatten(Points)
pt = Point([Point(2.091552925, 8.23893893, 0), Point(18.5418327, 8.23893893, 0), Point(10.36163893, 2.314715234, 0)])
pull = PullPoint(Point=hexgrid.Points, Geometry=pt, ClosestOnly=True)  # -> ClosestPoint, Distance
min = Minimum(A=pull.Distance, B=Slider(5, range=0..10))
bnd = Bounds(Numbers=flatten(min))
dom = ConstructDomain(DomainStart=Slider(0.168, range=0..1), DomainEnd=Slider(0.832, range=0..1))
remap = RemapNumbers(Value=min, Source=bnd, Target=dom)  # -> Mapped, Clipped
scale = Scale(Geometry=hexgrid.Cells, Center=hexgrid.Points, Factor=remap.Mapped)  # -> Geometry, Transform
merge = Merge(Data1=graft(hexgrid.Cells), Data2=graft(scale.Geometry))
boundary = BoundarySurfaces(Edges=merge)
Z = UnitZ(Factor=Slider(0.15, range=0..1))
extr = Extrude(Base=boundary, Direction=Z)  # -> flatten(Extrusion)

number_slider = Slider(20, range=0..100)
number_slider_2 = Slider(2, range=0..10)
move = Move(Geometry=xy, Motion=Y)  # -> Geometry, Transform
recgrid = Rectangular(
    Plane=move.Geometry,
    SizeX=number_slider_2,
    SizeY=number_slider_2,
    ExtentX=number_slider,
    ExtentY=Slider(12, range=0..100))  # -> Cells, Points
pcen = PolygonCenter(Polyline=recgrid.Cells)  # -> CenterV, CenterE, CenterA
crv = Curve(<curve referenced from the Rhino model>)
pull_2 = PullPoint(Point=pcen.CenterV, Geometry=crv, ClosestOnly=True)  # -> ClosestPoint, Distance
neg = Negative(Value=Slider(0.45, range=0..1))
multiplication = Multiplication(A=pull_2.Distance, B=neg)
Z_2 = UnitZ(Factor=multiplication)
neg_2 = Negative(Value=Z_2)
move_2 = Move(Geometry=pcen.CenterV, Motion=neg_2)  # -> Geometry, Transform
srfgrid = SurfaceFromPoints(Points=flatten(move_2.Geometry), UCount=number_slider, Interpolate=False)
dedom2 = DeconstructDomain²(Domain=srfgrid)  # -> UComponent, VComponent
bbox = BoundingBox(Content=extr, Plane=PlaneXY(0, 0, 0), UnionBox=True)  # -> Box, Box_2
srfmorph = SurfaceMorph(
    Geometry=extr,
    Reference=bbox.Box,
    Surface=srfgrid,
    UDomain=dedom2.UComponent,
    VDomain=dedom2.VComponent,
    WDomain=Slider(0.215, range=0..1))
