# Grasshopper definition 03.gh (Grasshopper 0.9.76)

rad = Radians(Degrees=Slider(120, range=0..360))
rad_2 = Radians(Degrees=Slider(125, range=0..360))
arc = Arc(Plane=PlaneXY(0, 0, 0), Radius=Slider(100, range=0..100), Angle=rad)  # -> Arc, Length
arc_2 = Arc(Plane=PlaneXY(0, 0, 0), Radius=Slider(50, range=0..100), Angle=rad_2)  # -> Arc, Length
rad_3 = Radians(Degrees=Slider(125, range=0..360))
number_slider = Slider(40, range=0..100)
dom = ConstructDomain(DomainStart=Slider(50, range=0..100), DomainEnd=Slider(200, range=0..1000))
rotate = Rotate(Geometry=arc_2.Arc, Angle=rad_3, Plane=PlaneXY(0, 0, 0))  # -> Geometry, Transform
range = Range(Domain=dom, Steps=number_slider)
divide = DivideCurve(Curve=arc.Arc, Count=number_slider, Kinks=False)  # -> Points, Tangents, Parameters
divide_2 = DivideCurve(Curve=rotate.Geometry, Count=number_slider, Kinks=False)  # -> Points, Tangents, Parameters
pt = ConstructPoint(XCoordinate=0, YCoordinate=0, ZCoordinate=range)
arc_3 = Arc3Pt(PointA=divide.Points, PointB=pt, PointC=divide_2.Points)  # -> Arc, Plane, Radius
number_slider_2 = Slider(200, range=0..1000)
loft = Loft(Curves=arc_3.Arc, Options={Adjust=False, Closed=False, LoftEnds=0, LoftSimp=0, LoftType=0, Rebuild=10, Refit=0.01})
dom_2 = ConstructDomain(DomainStart=Slider(5, range=0..10), DomainEnd=Slider(15, range=0..100))
divide_3 = DivideDomain²(Domain=loft, UCount=number_slider_2, VCount="1")
subsrf = Isotrim(Surface=loft, Domain=divide_3)
random = Random(Range=dom_2, Number=number_slider_2, Seed=2)
crv = Curve(subsrf)
divide_4 = DivideDomain²(Domain=subsrf, UCount="1", VCount=random)
subsrf_2 = Isotrim(Surface=graft(subsrf), Domain=divide_4)  # -> flatten(Surface)
pipe = Pipe(Curve=crv, Radius=Slider(0.1, range=0..0.1), Caps=Slider(2, range=0..10))
reduce = RandomReduce(List=subsrf_2, Reduction=Slider(500, range=0..1000), Seed=1)
dom² = ConstructDomain²(DomainU=Slider(0.9, range=0..1), DomainV=Slider(0.995, range=0..1))
subsrf_3 = Isotrim(Surface=reduce, Domain=dom²)
offset = Offset(Surface=subsrf_3, Distance=Slider(1, range=0..1), Retrim=Toggle(True))
