# Grasshopper definition music01.gh (Grasshopper 0.9.76)
# plug-ins: Firefly.X, Kangaroo Components, Weaverbird, Kangaroo2 Components, Firefly.Core

timer = Timer(TimerInterval=20, Target=capture)
number_slider = Slider(16, range=0..100)
capture = SoundCapture(TimePeriod=0.1, StartStopSoundCapture=True)  # -> WavePressureSamplesFromLeftChannel, WavePressureSamplesFromRightChannel, Volume
srf = Surface(<surface referenced from the Rhino model>)
smooth = SmoothingMovingAverage(Number=capture.Volume, Samples=Slider(5, range=0..10))
mesh_uv = MeshSurface(Surface=srf, UCount=number_slider, VCount=number_slider, Overhang=True, Equalize=False)
panel = Panel(smooth)
wbedges = WeaverbirdsMeshEdges(MeshOrPolylines=mesh_uv)
multiplication = Multiplication(A=panel, B=Slider(0.019, range=0..0.2))
wbvertices = WeaverbirdsVerticesComponent(MeshClosedPolylinesGroup=mesh_uv, Weld=True)
Z = UnitZ(Factor=Slider(3, range=0..10))
len = Length(Curve=wbedges)
mc = MeshCorners(Mesh=mesh_uv, Angle=2.35619449)
multiplication_2 = Multiplication(A=multiplication, B=len)
uforce = UnaryForce(Point=wbvertices, Force=Z)
springs = SpringsFromLine(Connection=wbedges, Stiffness=1000, Damping=10, RestLength=multiplication_2, UpperCutoff=0, LowerCutoff=0, Plasticity=0)
kangaroo = KangarooPhysics(
    ForceObjects=flatten([uforce, springs]),
    AnchorPoints=mc,
    Settings=null,
    Geometry=[wbedges, wbvertices],
    SimulationReset=True)  # -> Out, Iterations, ParticlesOut, flatten(GeometryOut), KE
data = Data(multiplication_2)
pt = Point(kangaroo.GeometryOut)
crv = Curve(kangaroo.GeometryOut)
Z_2 = UnitZ(Factor=1)
line = LineSDL(Start=pt, Direction=Z_2, Length=data)
preview = CustomPreview(Geometry=crv, Shader=ColourSwatch(SwatchColor=RGB(255, 255, 255)))
preview_2 = CustomPreview(Geometry=line, Shader=ColourSwatch(SwatchColor=RGB(224, 31, 31)))
