# Grasshopper definition music02.gh (Grasshopper 0.9.76)
# plug-ins: Firefly.X, EleFront, Weaverbird, Kangaroo2 Components, Firefly.Core

number_slider = Slider(300, range=0..1000)
rectangle = Rectangle(Plane=PlaneXY(0, 0, 0), XSize=number_slider, YSize=number_slider, Radius=0)  # -> Rectangle, Length
number_slider_2 = Slider(15, range=0..100)
boundary = BoundarySurfaces(Edges=rectangle.Rectangle)
timer = Timer(TimerInterval=20, Target=capture)
capture = SoundCapture(TimePeriod=0.1, StartStopSoundCapture=True)  # -> WavePressureSamplesFromLeftChannel, WavePressureSamplesFromRightChannel, Volume
number_slider_3 = Slider(0.5, range=0..1)
mesh_uv = MeshSurface(Surface=boundary, UCount=number_slider_2, VCount=number_slider_2, Overhang=True, Equalize=False)
number_slider_4 = Slider(300, range=0..1000)
smooth = SmoothingMovingAverage(Number=capture.Volume, Samples=Slider(10, range=0..10))
multiplication = Multiplication(A=smooth, B=Slider(0.022, range=0..0.1))
edgelengths = EdgeLengths(Mesh=mesh_uv, LengthFactor=multiplication, Strength=1)
mc = MeshCorners(Mesh=mesh_uv, Angle=2.35619449)
panel = Panel(multiplication)
show = Show(G=mesh_uv)
box = DomainBox(Base=PlaneXY(0, 0, 0), X=number_slider_4, Y=number_slider_4, Z=number_slider_4)
anchor = Anchor(Point=mc, Strength=10000)
debrep = DeconstructBrep(Brep=box)  # -> Faces, Edges, Vertices
pop3d = Populate3D(Region=box, Count=Slider(50, range=0..100), Seed=1)
pt = Point(debrep.Vertices)
bouncysolver = BouncySolver(
    GoalObjects=[edgelengths, show, anchor],
    Reset=Toggle(True),
    Threshold=1e-15,
    Tolerance=0.01,
    Damping=0.99,
    Iterations=10,
    On=True)  # -> I, V, O
voronoi³ = Voronoi3D(Points=pop3d, Box=box)  # -> Cells, Boundary
edges = BrepEdges(Brep=voronoi³.Cells)  # -> Naked, Interior, NonManifold
filtertype = FilterByType(Geometry=bouncysolver.O, ObjectType="mesh")
anchor_2 = Anchor(Point=pt, Strength=10000)
dupln = RemoveDuplicateLines(Lines=edges.Interior, Tolerance=0.01)
clean = CleanTree(RemoveNulls=True, RemoveInvalid=True, RemoveEmpty=False, Tree=filtertype)
num = Number(multiplication)
mesh = Mesh(clean)
multiplication_2 = Multiplication(A=num, B=Slider(35, range=0..100))
length_line = LengthLine(Line=dupln, Length=multiplication_2, Strength=10)
bouncysolver_2 = BouncySolver(GoalObjects=[anchor_2, length_line], Reset=False, Threshold=1e-15, Tolerance=0.01, Damping=0.99, Iterations=10, On=True)  # -> I, V, O
wbedges = WeaverbirdsMeshEdges(MeshOrPolylines=mesh)
panel_2 = Panel(multiplication_2)
