# Grasshopper definition music03.gh (Grasshopper 1.0.7)
# plug-ins: MosquitoAudio2, Firefly.Core

point = Point(Point(0, 0, 0))
unit_y = UnitY(Factor=Slider(166, range=0..200))
move = Move(Geometry=point, Motion=unit_y)  # -> Geometry, Transform
file_path = FilePath("C:\Users\win\Desktop\参数化电池\china_x.mp3")
audio_play = AudioPlay(String=file_path, Boolean=Toggle(True))
line = Line(StartPoint=point, EndPoint=move.Geometry)
number_slider = Slider(31, range=0..100)
data_recorder = DataRecorder(audio_play, DataLimit=10, RecordData=True)
point_on_curve = PointOnCurve(line, parameter=0.5)
timer = Timer(Interval=20, TimerInterval=20, Target=data_recorder_2)  # disabled
number_slider_2 = Slider(10, range=0..100)
circle = Circle(Plane=point_on_curve, Radius=number_slider)
multiplication = Multiplication(A=data_recorder, B=data_recorder)
multiplication_2 = Multiplication(A=multiplication, B=Slider(50, range=0..50))
divide_curve = DivideCurve(Curve=circle, Count=number_slider_2, Kinks=False)  # -> graft(Points), Tangents, Parameters
smoothing_moving_average = SmoothingMovingAverage(Number=multiplication_2, Samples=Slider(3, range=0..10))
data_recorder_2 = DataRecorder(audio_play, DataLimit=100, RecordData=True)
number_slider_3 = Slider(1, range=0..1)
circle_2 = Circle(Plane=divide_curve.Points, Radius=1)
unit_z = UnitZ(Factor=smoothing_moving_average)
move_2 = Move(Geometry=circle_2, Motion=unit_z)  # -> Geometry, Transform
multiplication_3 = Multiplication(A=data_recorder_2, B=Slider(17, range=0..40))
multiplication_4 = Multiplication(A=smoothing_moving_average, B=Slider(0.223, range=0..1))
series = Series(Start=number_slider_3, Step=number_slider_3, Count=number_slider_2)
circle_3 = Circle(Plane=divide_curve.Points, Radius=series)  # -> reverse(Circle)
scale_nu = ScaleNU(Geometry=move_2.Geometry, Plane=move_2.Geometry, ScaleX=multiplication_4, ScaleY=multiplication_4, ScaleZ=1)  # -> Geometry, Transform
multiplication_5 = Multiplication(A=multiplication_4, B=Slider(0.1, range=0..1))
scale_nu_2 = ScaleNU(Geometry=circle_3, Plane=circle_3, ScaleX=1, ScaleY=1, ScaleZ=1)  # -> Geometry, Transform
tree_statistics = TreeStatistics(Tree=scale_nu_2.Geometry)  # -> Paths, Length, Count
list_item = ListItem(List=tree_statistics.Paths, Index=0, Wrap=True)
split_tree = SplitTree(Data=scale_nu_2.Geometry, Masks=flatten(list_item))  # -> Positive, Negative
deconstruct_arc = DeconstructArc(Arc=split_tree.Positive)  # -> BasePlane, Radius, Angle
sort_list = SortList(Keys=deconstruct_arc.Radius)  # -> reverse(Keys), ValuesValuesA
smoothing_moving_average_2 = SmoothingMovingAverage(Number=multiplication_3, Samples=Slider(2, range=0..10))
bounds = Bounds(Numbers=unit_z)
bounds_2 = Bounds(Numbers=unit_z)
list_item_2 = ListItem(List=sort_list.Keys, Index=0, Wrap=True)
addition = Addition(A=number_slider, B=list_item_2)
addition_2 = Addition(A=addition, B=Slider(2, range=0..10))
circle_4 = Circle(Plane=point_on_curve, Radius=addition_2)
divide_curve_2 = DivideCurve(Curve=circle_4, Count=Slider(100, range=0..100), Kinks=False)  # -> Points, Tangents, Parameters
vector_2pt = Vector2Pt(PointA=point_on_curve, PointB=divide_curve_2.Points, Unitize=False)  # -> Vector, Length
deconstruct_domain = DeconstructDomain(Domain=bounds)  # -> Start, End
amplitude = Amplitude(Vector=vector_2pt.Vector, Amplitude=smoothing_moving_average_2)
deconstruct_domain_2 = DeconstructDomain(Domain=bounds_2)  # -> Start, End
gradient = Gradient(
    LowerLimit=deconstruct_domain.End,
    UpperLimit=deconstruct_domain.Start,
    Parameter=scale_nu.Geometry,
    stops=[0: RGB(255, 0, 0), 0.537: RGB(255, 255, 87), 1: RGB(0, 255, 242)])
move_3 = Move(Geometry=divide_curve_2.Points, Motion=amplitude)  # -> Geometry, Transform
gradient_2 = Gradient(
    LowerLimit=deconstruct_domain_2.Start,
    UpperLimit=deconstruct_domain_2.End,
    Parameter=scale_nu_2.Geometry,
    stops=[0: RGB(255, 0, 0), 0.292: RGB(255, 247, 87), 0.668: RGB(0, 166, 255), 1: RGB(79, 245, 54)])
custom_preview = CustomPreview(Geometry=scale_nu.Geometry, Material=gradient)
line_2 = Line(StartPoint=divide_curve_2.Points, EndPoint=move_3.Geometry)
interpolate = Interpolate(Vertices=move_3.Geometry, Degree=3, Periodic=invert(False), KnotStyle=1)  # -> Curve, Length, Domain
polyline = PolyLine(Vertices=move_3.Geometry, Closed=invert(False))
custom_preview_2 = CustomPreview(Geometry=scale_nu_2.Geometry, Material=gradient_2)
custom_preview_3 = CustomPreview(Geometry=line_2, Material=ColourSwatch(SwatchColor=RGB(255, 255, 255)))
